# Grasshopper definition test.gh (Grasshopper 1.0.7)

y_position = Slider(60, range=1..210)
x_position = Slider(71, range=1..150)
curve = Curve([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])
mesh = Mesh(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)
x_position_2 = GetNumber(x_position, AtLeast=1, AtMost=2147483647, Maximum=1.797693135e+308, Minimum=-1.797693135e+308)
y_position_2 = GetNumber(y_position, AtLeast=1, AtMost=2147483647, Maximum=1.797693135e+308, Minimum=-1.797693135e+308)
panel = Panel("""TRUE
FALSE
FALSE""")
construct_point = ConstructPoint(XCoordinate=x_position_2, YCoordinate=y_position_2, ZCoordinate=0)
unit_z = UnitZ(Factor=1)
cull_pattern = CullPattern(List=curve, CullPattern=invert(panel))
cull_pattern_2 = CullPattern(List=curve, CullPattern=panel)
project_point = ProjectPoint(Point=construct_point, Direction=unit_z, Geometry=mesh)  # -> Point, Index
dash_pattern = DashPattern(Curve=cull_pattern_2, Pattern=Slider(1.9, range=0.1..5))  # -> Dashes, Gaps
curve_2 = Curve(cull_pattern)
mesh_sphere_ex = MeshSphereEx(Base=project_point.Point, Radius=10, Count=5)
sphere = Sphere(Base=project_point.Point, Radius=Slider(13, range=1..40))
mesh_colours = MeshColours(Mesh=mesh_sphere_ex, Colours=ColourSwatch(SwatchColor=RGB(255, 125, 125)))
mesh_colours_2 = MeshColours(Mesh=mesh, Colours=ColourSwatch(SwatchColor=RGB(255, 212, 212)))

# ----
# Import Location from EPW File
panel_2 = Panel("http://climate.onebuilding.org/WMO_Region_4_North_and_Central_America/USA_United_States_of_America/WI_Wisconsin/USA_WI_Madison-Dane.County.Rgnl.AP-Truax.Field.726410_TMY3.zip")
downloadepw = LBDownloadWeather(weather_URL=panel_2)  # -> epw_file, stat_file, ddy_file; plug-in component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
importloc = LBImportLocation(epw_file=downloadepw.epw_file)  # -> location; plug-in component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

# ---- group: RH_IN:move_x
number_slider = Slider(4, range=1..10)

# ---- group: RH_IN:move_y
# Make "context" dynamic to make
# Rhino.Compute example more interesting!
number_slider_2 = Slider(6, range=1..10)

# ---- group: RH_IN:height
number_slider_3 = Slider(1, range=1..10)

# ----
# Analysis Period for
# Summer Solstice
panel_3 = Panel("6")
analysisperiod = LBAnalysisPeriod(start_month=panel_3, start_day="21", start_hour=0, end_month=panel_3, end_day="21", timestep="4")  # -> period, hoys, dates; plug-in component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

brep = Brep(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)
scale_nu = ScaleNU(Geometry=brep, Plane=PlaneXY(0, 0, 0), ScaleX=1, ScaleY=1, ScaleZ=number_slider_3)  # -> Geometry, Transform
vec = VectorXYZ(XComponent=number_slider, YComponent=number_slider_2, ZComponent=0)  # -> Vector, Length
move = Move(Geometry=scale_nu.Geometry, Motion=vec.Vector)  # -> Geometry, Transform

# ----
# Create Sunpath
panel_4 = Panel("20")
sunpath = LBSunPath(north=panel_4, location=importloc, hoys=analysisperiod.hoys, scale=1)  # -> report, vectors, altitudes, azimuths, hoys, sun_pts, analemma, daily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; plug-in component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

# ---- group: Run Me!
toggle = BooleanToggle(True)

# ----
# Run Direct Sun Study
panel_5 = Panel("0.1")
directsunhours = LBDirectSunHours(
    vectors=flatten(sunpath.vectors),
    timestep="4",
    geometry=flatten(sphere),
    context=flatten(mesh),
    grid_size="1",
    offset_dist=panel_5,
    run=toggle)  # -> report, points, results, mesh, legend, title, int_mtx; plug-in component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

# ---- group: RH_OUT:mesh
mesh_2 = Mesh([mesh_colours, mesh_colours_2])

# ---- group: RH_OUT:curve
curve_3 = Curve([dash_pattern.Dashes, curve_2])

# ---- group: RH_OUT:mesh
mesh_3 = Mesh(directsunhours.mesh)
