# Grasshopper definition twisted_tower.gh (Grasshopper 1.0.7)

cluster = Cluster()
rotation = Slider(24, range=0..180)
floor_thck = Slider(0.3, range=0.1..1.1)
lenght = Slider(40, range=10..100)
width = Slider(54, range=10..100)
f2f = Slider(3.6, range=3..7)
floors = Slider(27, range=1..30)
facade_position = GetNumber(Slider(0.8, range=0.8..1), AtLeast=1, AtMost=2147483647, Maximum=1.797693135e+308, Minimum=-1.797693135e+308)
length = GetNumber(lenght, AtLeast=1, AtMost=2147483647, Maximum=1.797693135e+308, Minimum=-1.797693135e+308)
floor_heigth = GetNumber(f2f, AtLeast=1, AtMost=2147483647, Maximum=1.797693135e+308, Minimum=-1.797693135e+308)
floors_2 = GetNumber(floors, AtLeast=1, AtMost=2147483647, Maximum=1.797693135e+308, Minimum=-1.797693135e+308)
rotation_2 = GetNumber(rotation, AtLeast=1, AtMost=2147483647, Maximum=1.797693135e+308, Minimum=-1.797693135e+308)
width_2 = GetNumber(width, AtLeast=1, AtMost=2147483647, Maximum=1.797693135e+308, Minimum=-1.797693135e+308)
pt = ConstructPoint(XCoordinate=0, YCoordinate=0, ZCoordinate=0)
rectangle = Rectangle(Plane=pt, XSize=length, YSize=width_2, Radius=0)  # -> Rectangle, Length
area = Area(Geometry=rectangle.Rectangle)  # -> Area, Centroid
area_2 = Area(Geometry=rectangle.Rectangle)  # -> Area, Centroid
series = Series(Start=0, Step=floor_heigth, Count=floors_2)
scale_nu = ScaleNU(
    Geometry=rectangle.Rectangle,
    Plane=area.Centroid,
    ScaleX=Slider(1.98, range=1..2),
    ScaleY=Slider(2, range=1..2),
    ScaleZ=1)  # -> Geometry, Transform
scale_nu_2 = ScaleNU(Geometry=rectangle.Rectangle, Plane=area_2.Centroid, ScaleX=facade_position, ScaleY=facade_position, ScaleZ=1)  # -> Geometry, Transform

Z = UnitZ(Factor=floor_thck)
neg = Negative(Value=Z)
extr = Extrude(Base=rectangle.Rectangle, Direction=neg)
cap = CapHoles(Brep=extr)

Z_2 = UnitZ(Factor=floor_thck)
neg_2 = Negative(Value=Z_2)
extr_2 = Extrude(Base=scale_nu.Geometry, Direction=neg_2)
settings_speed = SettingsSpeed()
subtraction = Subtraction(A=floor_heigth, B=floor_thck)
settings_speed_2 = SettingsSpeed()
cap_2 = CapHoles(Brep=extr_2)
Z_3 = UnitZ(Factor=subtraction)
cull_index = CullIndex(List=series, Indices=-1, Wrap=True)
mesh = MeshBrep(Brep=cap, Settings=settings_speed)
mesh_2 = MeshBrep(Brep=cap_2, Settings=settings_speed_2)
settings_speed_3 = SettingsSpeed()
Z_4 = UnitZ(Factor=series)
extr_3 = Extrude(Base=scale_nu_2.Geometry, Direction=Z_3)
Z_5 = UnitZ(Factor=cull_index)
move = Move(Geometry=mesh, Motion=Z_4)  # -> Geometry, Transform
move_2 = Move(Geometry=mesh_2, Motion=neg_2)  # -> Geometry, Transform
mesh_3 = MeshBrep(Brep=extr_3, Settings=settings_speed_3)
area_3 = Area(Geometry=move.Geometry)  # -> Area, Centroid
move_3 = Move(Geometry=mesh_3, Motion=Z_5)  # -> Geometry, Transform
lng = ListLength(List=move.Geometry)  # -> expr("X-1", Length)
dom = ConstructDomain(DomainStart=0, DomainEnd=rotation_2)
area_4 = Area(Geometry=move_3.Geometry)  # -> Area, Centroid
range = Range(Domain=dom, Steps=lng)
lng_2 = ListLength(List=move_3.Geometry)  # -> expr("X-1", Length)
dom_2 = ConstructDomain(DomainStart=0, DomainEnd=rotation_2)
rotate = Rotate(Geometry=move.Geometry, Angle=degrees(range), Plane=area_3.Centroid)  # -> Geometry, Transform
range_2 = Range(Domain=dom_2, Steps=lng_2)
rotate_2 = Rotate(Geometry=move_3.Geometry, Angle=degrees(range_2), Plane=area_4.Centroid)  # -> Geometry, Transform

# ---- group: RH_OUT:Mesh
mesh_4 = Mesh([rotate.Geometry, rotate_2.Geometry, move_2.Geometry])

# ==== cluster Cluster
